# Grasshopper definition RhinoToUnity.gh (Grasshopper 1.0.7)
# plug-ins: Extensions

panel = Panel("C:\Users\vicen\OneDrive - University College London\RC4 2017\Students\M4G\export.xml")

# ---- group: used to correct non-proper rigid transformations
panel_2 = Panel("Lshape")  # disabled
panel_3 = Panel("Straight")  # disabled
panel_4 = Panel("1")  # disabled
c_script = CSharpScript(N=panel_3, S=panel_4)  # -> out, A; inputs N: String, S: Double; disabled
# ---------- c_script: C# usings ----------
using System.Linq;
using Rhino.DocObjects;
# ---------- c_script: C# ----------
    string name = N;

    var definitions = RhinoDocument.InstanceDefinitions;
    InstanceDefinition definition = definitions.Find(name);
    var geo = definition.GetObjects();

    var scaled = geo.Select(g =>
      {
      GeometryBase s = g.Geometry;
      s.Transform(Transform.Scale(Point3d.Origin, S));
      return s;
      }).ToList();

    var atts = geo.Select(g => g.Attributes).ToList();

    var planes = new List<Plane>();

    foreach(var instance in definition.GetReferences(1))
    {
      var plane = Plane.WorldXY;
      plane.Transform(instance.InstanceXform);

      BoundingBox bbox = instance.Geometry.GetBoundingBox(true);

      var offset = plane;
      offset.Origin += plane.Normal * 0.1;

      var dist = offset.DistanceTo(bbox.Center);
      Print(dist.ToString());
      if( Math.Abs(dist) > 0.1)
      {
        plane.Origin += -plane.Normal * 0.1;
      }

      planes.Add(plane);
    }

    var xforms = planes.Select(p => Transform.PlaneToPlane(Plane.WorldXY, p));

    RhinoDocument.InstanceDefinitions.Delete(definition);

    var defIndex = RhinoDocument.InstanceDefinitions.Add(name, "", Point3d.Origin, scaled, atts);
    foreach(var xform in xforms)
      RhinoDocument.Objects.AddInstanceObject(defIndex, xform);

    A = planes;
# ---------- end c_script ----------

# ----
panel_5 = Panel("""Lshape
Straight""")
unityexport = UnityExport(BlockNames=panel_5, InstancesLayer="Instances", Density="600*0.25", AngleLimit="2", BreakForce="20000", FileName=panel)
